# Grasshopper definition Sweep_Railing_Columns.gh (Grasshopper 1.0.7)
# plug-ins: HAL for Grasshopper

# railing
sessionsettings = SessionSettings()
crv = Curve([<curve referenced from the Rhino model> x205])  # disabled
# columns along railing
crv_2 = Curve([<curve referenced from the Rhino model> x46])  # disabled
crv_3 = Curve(graft([<curve referenced from the Rhino model> x65]))  # disabled
panel = Panel("5")  # disabled
divide = DivideCurve(Curve=crv_2, Count=panel, Kinks=False)  # -> Points, Tangents, Parameters; disabled
srf = Surface(<surface referenced from the Rhino model>)  # disabled
end = EndPoints(Curve=crv_3)  # -> Start, End; disabled
panel_2 = Panel("0.0005")  # disabled
len = Length(Curve=crv)  # disabled
pln = Plane(srf)  # disabled
divide_2 = DivideCurve(Curve=crv_3, Count=10, Kinks=False)  # -> Points, Tangents, Parameters; disabled
srf_2 = Surface(<surface referenced from the Rhino model>)  # disabled
project = Project(Geometry=divide.Points, Plane=pln)  # -> Geometry, Transform; disabled
panel_3 = Panel("-1")  # disabled
panel_4 = Panel("-2")  # disabled
multiplication = Multiplication(A=len, B=panel_2)  # disabled
pln_2 = Plane(srf_2)  # disabled
item = ListItem(List=divide_2.Points, Index=panel_3, Wrap=True)  # disabled
item_2 = ListItem(List=divide_2.Points, Index=panel_4, Wrap=True)  # disabled
vec2pt = Vector2Pt(PointA=divide.Points, PointB=project.Geometry, Unitize=False)  # -> Vector, Length; disabled
ln = Line(StartPoint=divide.Points, EndPoint=project.Geometry)  # -> flatten(Line); disabled
divide_3 = DivideCurve(Curve=crv, Count=multiplication, Kinks=False)  # -> Points, Tangents, Parameters; disabled
project_2 = Project(Geometry=divide_3.Points, Plane=pln_2)  # -> Geometry, Transform; disabled
panel_5 = Panel("1.5")  # disabled
vec2pt_2 = Vector2Pt(PointA=item_2, PointB=item, Unitize=False)  # -> Vector, Length; disabled
circle = CircleCNR(Center=item, Normal=vec2pt_2.Vector, Radius=panel_5)  # disabled
ln_2 = Line(StartPoint=divide_3.Points, EndPoint=project_2.Geometry)  # -> flatten(Line); disabled
vec2pt_3 = Vector2Pt(PointA=divide_3.Points, PointB=project_2.Geometry, Unitize=False)  # -> Vector, Length; disabled
panel_6 = Panel("1.5")  # disabled
swp1 = Sweep1(Rail=crv_3, Sections=circle, Miter=1)  # disabled
circle_2 = CircleCNR(Center=divide.Points, Normal=vec2pt.Vector, Radius=panel_6)  # disabled
panel_7 = Panel("1.5")  # disabled
circle_3 = CircleCNR(Center=divide_3.Points, Normal=vec2pt_3.Vector, Radius=panel_7)  # disabled
extr = Extrude(Base=circle_2, Direction=vec2pt.Vector)  # disabled
extr_2 = Extrude(Base=circle_3, Direction=ln_2)  # disabled
